# Grasshopper definition SEC_[example]_LayoutMatrixApt.gh (Grasshopper 1.0.7)
# Copyright: prslvtsv
# plug-ins: Telepathy

# ---- group: appartments templates
size_in_y_dir = Slider(3, range=0..20)  # disabled
size_in_y_dir_2 = Slider(3, range=0..20)  # disabled
size_in_y_dir_3 = Slider(2, range=0..20)  # disabled
size_in_y_dir_4 = Slider(3, range=0..20)  # disabled
size_in_y_dir_5 = Slider(3, range=0..20)  # disabled
size_in_y_dir_6 = Slider(3, range=0..20)  # disabled
pt = Point([Point(17.1981432, -1.935424239, 0), Point(17.1981432, -2.935424239, 0), Point(17.1981432, -3.935424239, 0), Point(18.1981432, -1.935424239, 0), Point(18.1981432, -2.935424239, 0), Point(18.1981432, -3.935424239, 0)])  # disabled
crv = Curve([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])  # disabled
crv_2 = Curve([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])  # disabled
crv_3 = Curve([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])  # disabled
pt_2 = Point([Point(2.84037865, -1.935424239, 0), Point(2.84037865, -2.935424239, 0), Point(2.84037865, -3.935424239, 0)])  # disabled
pt_3 = Point([Point(0.8277938219, -1.935424239, 0), Point(0.8277938219, -2.935424239, 0)])  # disabled
pt_4 = Point([Point(22.01632453, -2.935424239, 0), Point(22.01632453, -1.935424239, 0), Point(21.01632453, -3.935424239, 0), Point(21.01632453, -2.935424239, 0), Point(21.01632453, -1.935424239, 0)])  # disabled
crv_4 = Curve([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])  # disabled
pt_5 = Point([Point(5.744305924, -1.935424239, 0), Point(5.744305924, -2.935424239, 0), Point(5.744305924, -3.935424239, 0), Point(6.744305924, -1.935424239, 0)])  # disabled
crv_5 = Curve([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])  # disabled
pt_6 = Point([Point(12.60996252, -1.935424239, 0), Point(12.60996252, -2.935424239, 0), Point(12.60996252, -3.935424239, 0), Point(13.60996252, -1.935424239, 0), Point(14.60996252, -1.935424239, 0), Point(13.60996252, -2.935424239, 0)])  # disabled
crv_6 = Curve([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])  # disabled
to_polyominos = ToPolyominos(pt_existing=pt, size_in_y_dir=size_in_y_dir, grid_cells=crv)  # -> ij_existing, cells_to_remove, size_xy; disabled
to_polyominos_2 = ToPolyominos(pt_existing=pt_2, size_in_y_dir=size_in_y_dir_2, grid_cells=crv_2)  # -> ij_existing, cells_to_remove, size_xy; disabled
to_polyominos_3 = ToPolyominos(pt_existing=pt_3, size_in_y_dir=size_in_y_dir_3, grid_cells=crv_3)  # -> ij_existing, cells_to_remove, size_xy; disabled
to_polyominos_4 = ToPolyominos(pt_existing=pt_4, size_in_y_dir=size_in_y_dir_4, grid_cells=crv_4)  # -> ij_existing, cells_to_remove, size_xy; disabled
to_polyominos_5 = ToPolyominos(pt_existing=pt_5, size_in_y_dir=size_in_y_dir_5, grid_cells=crv_5)  # -> ij_existing, cells_to_remove, size_xy; disabled
to_polyominos_6 = ToPolyominos(pt_existing=pt_6, size_in_y_dir=size_in_y_dir_6, grid_cells=crv_6)  # -> ij_existing, cells_to_remove, size_xy; disabled

# ---- group: read geometry inside frames / get selection frames
# get all the "selection frames"
pipeline = GeometryPipeline(
    GroupByLayer=False,
    GroupByType=False,
    IncludeHidden=False,
    IncludeLocked=False,
    LayerFilter="Floors_input::frames",
    NameFilter="*",
    SublayerFiltering=True,
    TypeFilter=5)

# ---- group: floor_matrix
size_in_y_dir_7 = Slider(11, range=0..20)
pt_7 = Point([Point(5.07795973, 10.93092413, 0), Point(4.07795973, 8.930924128, 0), Point(4.07795973, 9.930924128, 0), Point(4.07795973, 10.93092413, 0), Point(4.07795973, 11.93092413, 0), Point(4.07795973, 12.93092413, 0)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])
crv_7 = Curve([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])
to_polyominos_7 = ToPolyominos(pt_existing=pt_7, size_in_y_dir=size_in_y_dir_7, grid_cells=crv_7)  # -> ij_existing, cells_to_remove, size_xy
board_size = RemoteSender(to_polyominos_7.size_xy)
board_remove_cells = RemoteSender(to_polyominos_7.cells_to_remove)

# ---- group: read geometry inside frames
id = Guid(pipeline)
group_update_reg = RemoteReceiver()
read_floor = GhPythonScript(guid=id)  # -> out, tiles_geo, ref_geo, origin_pt, attr_txt, other_geo; inputs autoUpdate: Boolean
# ---------- read_floor: Python ----------
# -*- coding: utf-8 -*-
"""
@author: prslvtsv
"""
import scriptcontext as sc
import gblock.gh_context.gh_context as context
#reload(context)
#
################################################################################
## CONTEXT CREATOR BELOW | ADDS DEV METODS TO COMPONENT 
## SEE GH_CONTEXT\CONTEXT_GENERAL.TXT FOR DETAILS
################################################################################
##print context.init()[4]
#_verbose_init = False
#try:
#    exec(compile(context.init()[4], 'init', 'exec'), locals())
#except:
#    ghenv.Component.ExpireSolution(True)
################################################################################
#
##from Rhino.Geometry import Point3d, Point, Curve, Polyline, PolylineCurve
from Rhino.DocObjects import CurveObject, TextObject, PointObject
import gblock.core as core
import gblock.ghhelp as ghh
import gblock.event_handling as ev
import copy
reload(core)
reload(ghh)

tiles_geo  = []
ref_geo = []
attr_txt = []
other_geo = []
origin_pt = []

def read_guid_data():

    geo, layer = ghh.Helper.get_obj_by_region(guid)
    

    
    for i in range(len(geo)):
    
        g = ghh.Helper.get_by_id_obj(geo[i])
        g.UserDictionary.Clear()
        state_name = layer[i].split('::')[-1]
        group_name = layer[i].split('::')[-2]
        g.UserDictionary.Set('state', state_name)
        g.UserDictionary.Set('group', group_name)
            
        if isinstance(g, CurveObject):
           
            if group_name == 'tiles':
                tiles_geo.append(g)
            elif group_name == 'refgeo':
                ref_geo.append(g)
            else:
                print 'unsorted curve ', group_name, ' ', state_name
    
        elif isinstance(g, PointObject):
            if state_name == 'origin':
                origin_pt.append(g)
            else:
                print 'unsorted point ', group_name, ' ', state_name
            # print'point'
        elif isinstance(g, TextObject):
            if state_name == 'attrib_txt':
                for st in g.DisplayText.splitlines():
                    attr_txt.append(st)
                    
            else:
                print 'unsorted text ',  state_name
        else:
            print 'unsorted geometry ', group_name, ' ', state_name
#            other_geo.append(g)

ghenv.Component.Params.Input[1].Optional = True
if not ghenv.Component.Params.Input[1].VolatileData.IsEmpty:
    try:
        read_guid_data()
    except:
        print 'reading failed'
        ghenv.Component.ExpireSolution(True)
else:
#    ghenv.Component.AddRuntimeMessage(runtimeMessage.Warning, 'input data is missing')
    print 'no objects'
# ---------- end read_floor ----------
panel = Panel(read_floor.attr_txt)
panel_2 = Panel(read_floor.out)

# ----
appt_23_p = RemoteSender(to_polyominos_4.ij_existing)  # disabled
appt_23_o = RemoteSender(to_polyominos.ij_existing)  # disabled
appt_12_i = RemoteSender(to_polyominos_3.ij_existing)  # disabled
appt_13_i = RemoteSender(to_polyominos_2.ij_existing)  # disabled
appt_23_j = RemoteSender(to_polyominos_5.ij_existing)  # disabled
appt_33_j = RemoteSender(to_polyominos_6.ij_existing)  # disabled

# ---- group: creating filing matrix
python = GhPythonScript(size_i=Slider(3, range=0..10), size_j=Slider(5, range=0..10))  # -> out, a; inputs size_i: Int32, size_j: Int32
# ---------- python: Python ----------
# -*- coding: utf-8 -*-
"""
@author: prslvtsv
"""
###############################################################
#import ghdev.devcon as dev
#reload(dev)
#
#dev.init_dev_tools(locals(),  config=dev_options, verbose=True)
###############################################################
import gblock.elements.matrix as mtx
reload(mtx)


matrix = mtx.SpacialMatrix.create_empty((size_i, size_j))
print matrix.raw()

all_indexes = [(i, j) for j in range(size_j) for i in range(size_i)]
#matrix.fill_by_indexes(tuple(zip(tuple(range(3)), tuple(range(3)))), "obj")
print all_indexes
matrix.fill_by_indexes(all_indexes, "obj")
print matrix.raw()
# ---------- end python ----------

# ----
panel_3 = Panel(to_polyominos_4.ij_existing)  # disabled
panel_4 = Panel(python.out)
active = Panel(to_polyominos_7.ij_existing)
to_remove = Panel(to_polyominos_7.cells_to_remove)
to_remove_2 = Panel(to_polyominos_7.size_xy)
merge = Merge(
    Data1=to_polyominos_3.ij_existing,
    Data2=to_polyominos_2.ij_existing,
    Data3=to_polyominos_5.ij_existing,
    Data4=to_polyominos_6.ij_existing,
    Data5=to_polyominos.ij_existing,
    Data6=to_polyominos_4.ij_existing)  # disabled
python_2 = GhPythonScript(x=merge)  # -> a; inputs x: list; disabled
# ---------- python_2: Python ----------
# -*- coding: utf-8 -*-
"""
@author: prslvtsv
"""
###############################################################
#import ghdev.devcon as dev
#reload(dev)
#
#dev.init_dev_tools(locals(),  config=dev_options, verbose=True)
###############################################################

a = "..".join(x)
# ---------- end python_2 ----------
tileset_all_apprt = RemoteSender(python_2)  # disabled
panel_5 = Panel(python_2)  # disabled

# ---- group: create from indexes
python_3 = GhPythonScript(indexes_str=active)  # -> out, a
# ---------- python_3: Python ----------
# -*- coding: utf-8 -*-
"""
@author: prslvtsv
"""
###############################################################
#import ghdev.devcon as dev
#reload(dev)
#
#dev.init_dev_tools(locals(),  config=dev_options, verbose=True)
###############################################################
import gblock.elements.matrix as mtx
reload(mtx)

indx = mtx.SpacialMatrix.parse_indexes(indexes_str)
print indx
print ()
matrix = mtx.SpacialMatrix.create_from_indexes(indx, data="cell")
print matrix.raw()
print()
print matrix.active_indexes()
print()

corresponding_data = [ "C::{}:{}".format(ix[0], ix[1]) for ix in indx]
matrix_ix = mtx.SpacialMatrix.create_from_indexes(indx, data=corresponding_data)
def gp(a):
    print a
    
[gp(line) for line in  matrix_ix.raw()]
# ---------- end python_3 ----------

# ---- group: appartments templates
appt_23_o_2 = RemoteReceiver(appt_23_o)
appt_23_p_2 = RemoteReceiver(appt_23_p)
appt_13_i_2 = RemoteReceiver(appt_13_i)
appt_23_j_2 = RemoteReceiver(appt_23_j)
appt_33_j_2 = RemoteReceiver(appt_33_j)
appt_12_i_2 = RemoteReceiver(appt_12_i)

# ----
active_2 = Panel(python_3.out)
python_4 = GhPythonScript()  # -> out, board, tiling; inputs result_in: list
# ---------- python_4: Python ----------
# -*- coding: utf-8 -*-
"""
@author: prslvtsv
"""
###############################################################
#import ghdev.devcon as dev
#reload(dev)
#
#dev.init_dev_tools(locals(),  config=dev_options, verbose=True)
###############################################################

print type(result_in[0])
exec("board = {}".format(result_in[0].strip())) 
exec("tiling = {}".format(result_in[1].strip())) 
#board = result_in[0]
#tiling = result_in[1]
# ---------- end python_4 ----------

# ---- group: parse tiling
python_5 = GhPythonScript(cells=python_4.tiling)  # -> out, x, y
# ---------- python_5: Python ----------
# -*- coding: utf-8 -*-
"""
@author: prslvtsv
"""
###############################################################
#import ghdev.devcon as dev
#reload(dev)
#
#dev.init_dev_tools(locals(),  config=dev_options, verbose=True)
###############################################################

x= []
y = []

print cells
srt = sorted(cells)
print srt
for c in srt:
    
    x.append(c[0])
    y.append(c[1])
# ---------- end python_5 ----------

# ---- group: parse board
python_6 = GhPythonScript(cells=python_4.board)  # -> out, x, y; inputs cells: list
# ---------- python_6: Python ----------
# -*- coding: utf-8 -*-
"""
@author: prslvtsv
"""
###############################################################
#import ghdev.devcon as dev
#reload(dev)
#
#dev.init_dev_tools(locals(),  config=dev_options, verbose=True)
###############################################################

x= []
y = []

srt = sorted(cells)
print srt
for c in srt:
    
    x.append(c[0])
    y.append(c[1])
# ---------- end python_6 ----------

# ---- group: generate geometry
tiling = Tiling(index_x=python_5.x, index_y=python_5.y)  # -> cell_srf, cell_rect, cell_pt

# ----
bbox = BoundingBox(Content=flatten(tiling.cell_pt), Plane=PlaneXY(0, 0, 0), UnionBox=True)  # -> Box, Box_2

# ---- group: generate geometry
tiling_2 = Tiling(index_x=python_6.x, index_y=python_6.y)  # -> cell_srf, cell_rect, cell_pt

# ----
dim = Dimensions(Surface=bbox.Box)  # -> UDimension, VDimension
multiplication = Multiplication(A=dim.UDimension, B=2)
X = UnitX(Factor=multiplication)
move = Move(Geometry=tiling.cell_rect, Motion=X)  # -> Geometry, Transform

# ---- group: custom display
display = Display(geo_to_viz=move.Geometry)

display_2 = Display(geo_to_viz=tiling_2.cell_rect)

# ==== cluster ToPolyominos
grid_cells = ClusterInput()  # grid_cells
size_in_y_dir = ClusterInput()  # size in Y dir
pt_existing = ClusterInput()  # pt_existing
data = Data(grid_cells)
pcen = PolygonCenter(Polyline=data)  # -> CenterV, CenterE, CenterA
sort_pt = SortPoints(Points=pcen.CenterV)  # -> Points, Indices
data_2 = Data(size_in_y_dir)
data_3 = Data(pt_existing)
partition = PartitionList(List=sort_pt.Points, Size=data_2)
cir = Circle(Plane=data_3, Radius=0.3)
sort_pt_2 = SortPoints(Points=partition)  # -> Points, Indices
pdecon = Deconstruct(Point=sort_pt_2.Points)  # -> XComponent, YComponent, ZComponent
panel = Panel(sort_pt_2.Points)
sort = SortList(Keys=pdecon.YComponent, ValuesA=sort_pt_2.Points)  # -> Keys, ValuesA
flip = FlipMatrix(Data=sort.ValuesA)
ptcomposenum = ComposeGridNumber(Points=flatten(flip), RowNum=data_2)
incurve = PointInCurve(Point=graft(ptcomposenum), Curve=cir)  # -> Relationship, Point
ma = MassAddition(Input=incurve.Relationship)  # -> Result, PartialResults
viewer = ParamViewer(ptcomposenum)
trim = TrimTree(Tree=ma.Result, Depth=1)
bool = Boolean(ma.Result)
bool_2 = Boolean(trim)
not = GateNot(A=bool_2)
ptindices = ExtractGridIndices(Grid=ptcomposenum)  # -> I_Indices, J_Indices
branch = TreeBranch(Tree=ptcomposenum, Path=Slider(0, range=0..10), MaintainPaths=True)
cull = CullPattern(List=ptindices.I_Indices, CullPattern=bool_2)
cull_2 = CullPattern(List=ptindices.J_Indices, CullPattern=bool_2)
cull_3 = CullPattern(List=ptindices.J_Indices, CullPattern=not)
cull_4 = CullPattern(List=ptindices.I_Indices, CullPattern=not)
lng = ListLength(List=ptcomposenum)  # -> flatten(Length)
clean = CleanTree(RemoveNulls=True, RemoveInvalid=True, RemoveEmpty=True, Tree=cull_4)
clean_2 = CleanTree(RemoveNulls=True, RemoveInvalid=True, RemoveEmpty=True, Tree=cull_3)
python = GhPythonScript(x=cull_2, y=cull)  # -> out, a
# ---------- python: Python ----------
# -*- coding: utf-8 -*-
"""
@author: prslvtsv
"""
a = "{},{}".format(x, y)
# ---------- end python ----------
item = ListItem(List=lng, Index=0, Wrap=True)
lng_2 = ListLength(List=lng)
python_2 = GhPythonScript(x=clean_2, y=clean)  # -> out, flatten(a); same code as python
python_3 = GhPythonScript(x=flatten(python_2.a))  # -> out, a; inputs x: list
# ---------- python_3: Python ----------
# -*- coding: utf-8 -*-
"""
@author: prslvtsv
"""
b = ", ".join(x)
a = "[" + b + "]"
# ---------- end python_3 ----------
python_4 = GhPythonScript(x=flatten(python.a))  # -> out, a; inputs x: list
# ---------- python_4: Python ----------
# -*- coding: utf-8 -*-
"""
@author: prslvtsv
"""
b = ":".join(x)
a = b
# ---------- end python_4 ----------
merge = Merge(Data1=item, Data2=lng_2)
python_5 = GhPythonScript(x=flatten(python_2.a))  # -> out, a; inputs x: list
# ---------- python_5: Python ----------
# -*- coding: utf-8 -*-
"""
@author: prslvtsv
"""
j = ":".join(x)
a = j
# ---------- end python_5 ----------
join = TextJoin(Text=merge, Join=",")
ij_existing = ClusterOutput(python_4.a)  # ij_existing
cells_to_remove = ClusterOutput(python_5.a)  # ij_remove
panel_2 = Panel(python_5.a)
size_xy = ClusterOutput(join)  # size_XY

# ==== cluster Tiling
index_y = ClusterInput()  # index Y
index_x = ClusterInput()  # index X
data = Data(Slider(1, range=0..1))
Y = Data(index_y)
X = Data(index_x)
ghpython_script = GhPythonScript(x=X, c=data)  # -> a
# ---------- ghpython_script: Python ----------
# -*- coding: utf-8 -*-
"""
@author: prslvtsv
"""
###############################################################
#import ghdev.devcon as dev
#reload(dev)
#
#dev.init_dev_tools(locals(),  config=dev_options, verbose=True)
###############################################################


a = x*c
# ---------- end ghpython_script ----------
ghpython_script_2 = GhPythonScript(x=Y, c=data)  # -> a; same code as ghpython_script
ghpython_script_3 = GhPythonScript(x=X, c=data)  # -> a
# ---------- ghpython_script_3: Python ----------
# -*- coding: utf-8 -*-
"""
@author: prslvtsv
"""
###############################################################
#import ghdev.devcon as dev
#reload(dev)
#
#dev.init_dev_tools(locals(),  config=dev_options, verbose=True)
###############################################################


a = x*c + c
# ---------- end ghpython_script_3 ----------
ghpython_script_4 = GhPythonScript(x=Y, c=data)  # -> a; same code as ghpython_script_3
pt = ConstructPoint(XCoordinate=ghpython_script, YCoordinate=ghpython_script_2, ZCoordinate=0)
pt_2 = ConstructPoint(XCoordinate=ghpython_script_3, YCoordinate=ghpython_script_4, ZCoordinate=0)
rec_2pt = Rectangle2Pt(Plane=PlaneXY(0, 0, 0), PointA=pt, PointB=pt_2, Radius=0)  # -> Rectangle, Length
pcen = PolygonCenter(Polyline=rec_2pt.Rectangle)  # -> CenterV, CenterE, CenterA
boundary = BoundarySurfaces(Edges=rec_2pt.Rectangle)
cell_srf = ClusterOutput(boundary)  # cell_srf
cell_rect = ClusterOutput(rec_2pt.Rectangle)  # cell_rect
cell_pt = ClusterOutput(pcen.CenterV)  # cell_pt

# ==== cluster Display
geo_to_viz = ClusterInput()
data = Data(geo_to_viz)
color = Color(data_in=data)
runion = RegionUnion(Curves=data)
boundary = BoundarySurfaces(Edges=runion)
addition = Addition(A=color, B=ColourSwatch(SwatchColor=RGB(150, 150, 150)))
preview = CustomPreview(Geometry=simplify(boundary), Material=simplify(color))
previewlw = CustomPreviewLineweights(
    Geometry=simplify(runion),
    Shader=simplify(ColourSwatch(SwatchColor=RGBA(0, 0, 0, 212))),
    Thickness=Slider(2, range=0..10),
    Absolute=False)
previewlw_2 = CustomPreviewLineweights(Geometry=simplify(data), Shader=simplify(addition), Thickness=Slider(0, range=0..10), Absolute=False)
previewmat = CustomPreviewMaterials(Geometry=boundary, DiffuseColor=color, Transparency=Slider(0.197, range=0..1))
createhatch = CreateHatch(Bake=False, Curves=runion, HatchPatternName="Hatch1", HatchScale=0.8, HatchRotation=45)  # -> HatchGeometry, HatchObjects
number_slider = Slider(0.625, range=0..1)
preview_2 = CustomPreview(Geometry=simplify(createhatch.HatchGeometry), Material=simplify(color))

# ==== cluster Color
data_in = ClusterInput()  # data_in
dom = ConstructDomain(DomainStart=Slider(0.168, range=0..1), DomainEnd=Slider(0.922, range=0..1))
tstat = TreeStatistics(Tree=data_in)  # -> Paths, Length, Count
bbox = BoundingBox(Content=data_in, Plane=PlaneXY(0, 0, 0), UnionBox=True)  # -> Box, Box_2
extremums = MinMax(Number=tstat.Length)  # -> Minimum, Maximum
range = Range(Domain=dom, Steps=expr("x-1", tstat.Length))
dim = Dimensions(Surface=bbox.Box)  # -> UDimension, VDimension
area = Area(Geometry=bbox.Box)  # -> Area, Centroid
pcshuffle = Shuffle(List=range, Seed=Slider(1, range=0..1), LastSaveLocalization="neutral,N")
extremums_2 = MinMax(Number=flatten(dim.UDimension))  # -> Minimum, Maximum
wheel = ColourWheel(
    extremums_2.Maximum,
    ColourGrips_Style=10,
    ColourGrips_Grip=[5.115610268, 3.821325235, 1.989214472, 5.130807126],
    ColourGrips_Lum=[0.1, 1],
    ColourGrips_Range=[0.5123760279, 0.5123760279, 0.5123760279, 0.5123760279],
    ColourGrips_Sat=[0.2, 1])
addition = Addition(A=dim.UDimension, B=area.Area)
hsv = ColourHSV(Alpha=1, Hue=pcshuffle, Saturation=1, Value=1)
subtraction = Subtraction(A=dim.UDimension, B=extremums_2.Minimum)
hsl = ColourHSL(Alpha=0.7, Hue=pcshuffle, Saturation=1, Luminance=Slider(0.247, range=0..1))
data = Data(graft(wheel))
data_2 = Data(simplify(graft(hsv)))
item = ListItem(List=hsv, Index=subtraction, Wrap=True)  # -> simplify(Item)
panel = Panel(dim.UDimension)
addition_2 = Addition(A=data_2, B=item)
division = Division(A=addition_2, B=2)
panel_2 = Panel(division)
color_out = ClusterOutput(item)  # color_out
